# Grasshopper definition boat.midterm.gh (Grasshopper 1.0.7)
# plug-ins: Bifocals, LunchBox

number_slider = Slider(32.99981, range=0..200)
division = Division(A=number_slider, B=Slider(5.7, range=0..10))
division_2 = Division(A=number_slider, B=Slider(2.5, range=0..10))
subtraction = Subtraction(A=division, B=Slider(1.7, range=0..10))
subtraction_2 = Subtraction(A=number_slider, B=Slider(29.5, range=0..100))
subtraction_3 = Subtraction(A=number_slider, B=Slider(27.498, range=0..100))
subtraction_4 = Subtraction(A=number_slider, B=Slider(32.5, range=0..100))
subtraction_5 = Subtraction(A=subtraction, B=Slider(1, range=0..10))
subtraction_6 = Subtraction(A=number_slider, B=Slider(6.23, range=0..10))
subtraction_7 = Subtraction(A=division, B=Slider(1.2, range=0..10))
addition = Addition(A=subtraction_4, B=Slider(0.9, range=0..1.5))
subtraction_8 = Subtraction(A=division_2, B=Slider(6.7, range=0..10))
addition_2 = Addition(A=subtraction_2, B=Slider(1.3, range=0..10))
negative = Negative(Value=division_2)
subtraction_9 = Subtraction(A=negative, B=Slider(7.7, range=0..10))
subtraction_10 = Subtraction(A=subtraction_9, B=Slider(8, range=0..10))
subtraction_11 = Subtraction(A=subtraction_9, B=Slider(2.7, range=0..10))
negative_2 = Negative(Value=number_slider)
multiplication = Multiplication(A=number_slider, B=Slider(1.9, range=0..10))
addition_3 = Addition(A=division_2, B=Slider(1.5, range=0..10))
negative_3 = Negative(Value=subtraction_8)
negative_4 = Negative(Value=subtraction_3)
construct_point = ConstructPoint(XCoordinate=0, YCoordinate=0, ZCoordinate=0)
cylinder = Cylinder(Base=construct_point, Radius=0.5, Length=multiplication)
construct_point_2 = ConstructPoint(XCoordinate=number_slider, YCoordinate=0, ZCoordinate=subtraction_4)
construct_point_3 = ConstructPoint(XCoordinate=negative_2, YCoordinate=0, ZCoordinate=subtraction_7)
construct_point_4 = ConstructPoint(XCoordinate=0, YCoordinate=addition_3, ZCoordinate=division)
construct_point_5 = ConstructPoint(XCoordinate=0, YCoordinate=negative, ZCoordinate=division)
construct_point_6 = ConstructPoint(XCoordinate=subtraction_6, YCoordinate=subtraction_3, ZCoordinate=subtraction_5)
construct_point_7 = ConstructPoint(XCoordinate=subtraction_6, YCoordinate=negative_4, ZCoordinate=subtraction_5)
construct_point_8 = ConstructPoint(XCoordinate=number_slider, YCoordinate=0, ZCoordinate=subtraction_2)
construct_point_9 = ConstructPoint(XCoordinate=subtraction_9, YCoordinate=0, ZCoordinate=0)
construct_point_10 = ConstructPoint(XCoordinate=subtraction_10, YCoordinate=0, ZCoordinate=addition)
construct_point_11 = ConstructPoint(XCoordinate=subtraction_11, YCoordinate=subtraction_8, ZCoordinate=addition_2)
construct_point_12 = ConstructPoint(XCoordinate=subtraction_11, YCoordinate=negative_3, ZCoordinate=addition_2)
unit_z = UnitZ(Factor=Slider(2, range=1..15))

# ----
# front bottem half
line = Line(StartPoint=construct_point, EndPoint=construct_point_9)
arc_3pt = Arc3Pt(PointA=construct_point_9, PointB=construct_point_10, PointC=construct_point_3)  # -> Arc, Plane, Radius
arc_3pt_2 = Arc3Pt(PointA=construct_point_4, PointB=construct_point_11, PointC=construct_point_3)  # -> Arc, Plane, Radius
arc_3pt_3 = Arc3Pt(PointA=construct_point_5, PointB=construct_point_12, PointC=construct_point_3)  # -> Arc, Plane, Radius

# ----
# back bottem half
line_2 = Line(StartPoint=construct_point_2, EndPoint=construct_point_8)
arc_3pt_4 = Arc3Pt(PointA=construct_point_3, PointB=construct_point, PointC=construct_point_2)  # -> Arc, Plane, Radius
arc_3pt_5 = Arc3Pt(PointA=construct_point_4, PointB=construct_point, PointC=construct_point_5)  # -> Arc, Plane, Radius
arc_3pt_6 = Arc3Pt(PointA=construct_point_4, PointB=construct_point_6, PointC=construct_point_8)  # -> Arc, Plane, Radius
arc_3pt_7 = Arc3Pt(PointA=construct_point_5, PointB=construct_point_7, PointC=construct_point_8)  # -> Arc, Plane, Radius

number_slider_2 = Slider(3, range=1..7)
number_slider_3 = Slider(4, range=1..7)
move = Move(
    Geometry=[construct_point_8, construct_point_11, construct_point_12, construct_point_5, construct_point_4, construct_point_3, construct_point_7, construct_point_6],
    Motion=unit_z)  # -> Geometry, Transform
list_item = ListItem(
    List=move.Geometry,
    Index=[Slider(1, range=0..7), number_slider_2, number_slider_3, Slider(2, range=0..7), Slider(5, range=0..7)],
    Wrap=True)
divide_curve = DivideCurve(Curve=arc_3pt_5.Arc, Count=Slider(4, range=0..100), Kinks=False)  # -> Points, Tangents, Parameters
list_item_2 = ListItem(List=list_item, Index=Slider(1, range=0..5), Wrap=True)
list_item_3 = ListItem(
    List=move.Geometry,
    Index=[number_slider_2, number_slider_3, Slider(6, range=1..7), Slider(7, range=1..7), Slider(8, range=1..8)],
    Wrap=True)
list_item_4 = ListItem(List=list_item, Index=Slider(3, range=0..5), Wrap=True)
list_item_5 = ListItem(List=list_item, Index=Slider(4, range=0..5), Wrap=True)
divide_curve_2 = DivideCurve(Curve=arc_3pt_6.Arc, Count=Slider(2, range=0..3), Kinks=False)  # -> Points, Tangents, Parameters
list_item_6 = ListItem(List=list_item, Index=Slider(0, range=0..5), Wrap=True)
list_item_7 = ListItem(List=divide_curve.Points, Index=Slider(1, range=0..4), Wrap=True)
list_item_8 = ListItem(List=divide_curve.Points, Index=Slider(3, range=1..4), Wrap=True)
list_item_9 = ListItem(List=list_item_3, Index=Slider(0, range=0..4), Wrap=True)
list_item_10 = ListItem(List=list_item, Index=Slider(2, range=0..5), Wrap=True)
divide_curve_3 = DivideCurve(Curve=arc_3pt_7.Arc, Count=Slider(2, range=0..3), Kinks=False)  # -> Points, Tangents, Parameters
line_3 = Line(StartPoint=construct_point_5, EndPoint=list_item_9)
list_item_11 = ListItem(List=divide_curve_2.Points, Index=Slider(1, range=0..5), Wrap=True)
arc_3pt_8 = Arc3Pt(PointA=construct_point, PointB=list_item_7, PointC=construct_point_4)  # -> Arc, Plane, Radius
arc_3pt_9 = Arc3Pt(PointA=construct_point, PointB=list_item_8, PointC=construct_point_5)  # -> Arc, Plane, Radius
list_item_12 = ListItem(List=list_item_3, Index=Slider(2, range=0..4), Wrap=True)
number_slider_4 = Slider(3, range=1..5)
list_item_13 = ListItem(List=list_item_3, Index=Slider(3, range=0..4), Wrap=True)
arc_3pt_10 = Arc3Pt(PointA=construct_point_4, PointB=list_item_11, PointC=construct_point_6)  # -> Arc, Plane, Radius
list_item_14 = ListItem(List=divide_curve_3.Points, Index=Slider(1, range=0..5), Wrap=True)
arc_3pt_11 = Arc3Pt(PointA=list_item_2, PointB=list_item_4, PointC=list_item_5)  # -> Arc, Plane, Radius
arc_3pt_12 = Arc3Pt(PointA=list_item_5, PointB=list_item_6, PointC=list_item_10)  # -> Arc, Plane, Radius
list_item_15 = ListItem(List=list_item_3, Index=Slider(1, range=0..4), Wrap=True)
line_4 = Line(StartPoint=construct_point_4, EndPoint=list_item_15)
line_5 = Line(StartPoint=construct_point_3, EndPoint=list_item_5)
arc_3pt_13 = Arc3Pt(PointA=construct_point_5, PointB=list_item_14, PointC=construct_point_7)  # -> Arc, Plane, Radius
negative_5 = Negative(Value=number_slider_4)
unit_y = UnitY(Factor=number_slider_4)
unit_y_2 = UnitY(Factor=negative_5)
list_item_16 = ListItem(List=list_item_3, Index=Slider(4, range=0..4), Wrap=True)
move_2 = Move(Geometry=list_item_16, Motion=unit_y)  # -> Geometry, Transform
move_3 = Move(Geometry=list_item_16, Motion=unit_y_2)  # -> Geometry, Transform
divide_curve_4 = DivideCurve(Curve=arc_3pt_6.Arc, Count=Slider(8, range=0..20), Kinks=False)  # -> Points, Tangents, Parameters
list_item_17 = ListItem(List=divide_curve_4.Points, Index=Slider(7, range=0..8), Wrap=True)
divide_curve_5 = DivideCurve(Curve=arc_3pt_7.Arc, Count=Slider(8, range=0..20), Kinks=False)  # -> Points, Tangents, Parameters
arc_3pt_14 = Arc3Pt(PointA=construct_point_6, PointB=list_item_17, PointC=construct_point_8)  # -> Arc, Plane, Radius
list_item_18 = ListItem(List=divide_curve_5.Points, Index=Slider(7, range=0..8), Wrap=True)
line_6 = Line(StartPoint=move_3.Geometry, EndPoint=construct_point_8)
line_7 = Line(StartPoint=list_item_13, EndPoint=move_2.Geometry)
line_8 = Line(StartPoint=move_2.Geometry, EndPoint=construct_point_8)
line_9 = Line(StartPoint=move_2.Geometry, EndPoint=move_3.Geometry)
line_10 = Line(StartPoint=list_item_13, EndPoint=construct_point_6)
line_11 = Line(StartPoint=move_3.Geometry, EndPoint=list_item_12)
line_12 = Line(StartPoint=list_item_15, EndPoint=list_item_13)
line_13 = Line(StartPoint=list_item_12, EndPoint=list_item_9)
line_14 = Line(StartPoint=list_item_12, EndPoint=construct_point_7)
# hull
arc_3pt_15 = Arc3Pt(PointA=construct_point_7, PointB=list_item_18, PointC=construct_point_8)  # -> Arc, Plane, Radius
geometry = Geometry([arc_3pt_3.Arc, arc_3pt_2.Arc, arc_3pt_7.Arc, arc_3pt_6.Arc])
md_slider = MDSlider(
    SliderMode=0,
    slider_value=Point(0.7804878049, 0.5609756098, 0.5),
    x_domain=Domain(0, 1),
    y_domain=Domain(0, 1),
    z_domain=Domain(0, 1))
scale = Scale(Geometry=geometry, Center=Point(0, 0, 0), Factor=md_slider)  # -> Geometry, Transform
md_slider_2 = MDSlider(
    SliderMode=0,
    slider_value=Point(0.7804878049, 0.5609756098, 0.5),
    x_domain=Domain(0, 1),
    y_domain=Domain(0, 1),
    z_domain=Domain(0, 1))
geometry_2 = Geometry([line_7, line_9, line_11, line_12, line_13, arc_3pt_11.Arc, arc_3pt_12.Arc])
divide_curve_6 = DivideCurve(Curve=scale.Geometry, Count=Slider(5, range=0..10), Kinks=False)  # -> Points, Tangents, Parameters
scale_2 = Scale(Geometry=geometry_2, Center=Point(0, 0, 0), Factor=md_slider_2)  # -> Geometry, Transform
list_item_19 = ListItem(List=divide_curve_6.Points, Index=Slider(0, range=0..5), Wrap=True)
list_item_20 = ListItem(List=divide_curve_6.Points, Index=Slider(1, range=0..5), Wrap=True)
list_item_21 = ListItem(List=divide_curve_6.Points, Index=Slider(2, range=0..5), Wrap=True)
list_item_22 = ListItem(List=divide_curve_6.Points, Index=Slider(3, range=0..5), Wrap=True)
list_item_23 = ListItem(List=divide_curve_6.Points, Index=Slider(4, range=0..5), Wrap=True)
list_item_24 = ListItem(List=divide_curve_6.Points, Index=Slider(5, range=0..5), Wrap=True)
divide_curve_7 = DivideCurve(Curve=scale_2.Geometry, Count=Slider(2, range=0..10), Kinks=False)  # -> Points, Tangents, Parameters
explode_tree = ExplodeTree(Data=list_item_19)  # -> Branch0, Branch1, Branch2, Branch3
explode_tree_2 = ExplodeTree(Data=list_item_20)  # -> Branch0, Branch1, Branch2, Branch3
explode_tree_3 = ExplodeTree(Data=list_item_21)  # -> Branch0, Branch1, Branch2, Branch3
explode_tree_4 = ExplodeTree(Data=list_item_22)  # -> Branch0, Branch1, Branch2, Branch3
explode_tree_5 = ExplodeTree(Data=list_item_23)  # -> Branch0, Branch1, Branch2, Branch3
explode_tree_6 = ExplodeTree(Data=list_item_24)  # -> Branch0, Branch1, Branch2, Branch3
point = Point(explode_tree_2.Branch1)
list_item_25 = ListItem(List=divide_curve_7.Points, Index=Slider(2, range=0..6), Wrap=True)
list_item_26 = ListItem(List=divide_curve_7.Points, Index=Slider(0, range=0..21), Wrap=True)
list_item_27 = ListItem(List=divide_curve_7.Points, Index=Slider(1, range=0..6), Wrap=True)
panel = Panel(point)
explode_tree_7 = ExplodeTree(Data=list_item_25)  # -> Branch0, Branch1, Branch2, Branch3, Branch4, Branch5, Branch6
explode_tree_8 = ExplodeTree(Data=list_item_26)  # -> Branch0, Branch1, Branch2, Branch3, Branch4, Branch5, Branch6
explode_tree_9 = ExplodeTree(Data=list_item_27)  # -> Branch0, Branch1, Branch2, Branch3, Branch4, Branch5, Branch6
line_15 = Line(StartPoint=explode_tree_8.Branch0, EndPoint=explode_tree_5.Branch3)
line_16 = Line(StartPoint=explode_tree_5.Branch3, EndPoint=explode_tree_6.Branch2)
line_17 = Line(StartPoint=explode_tree_8.Branch2, EndPoint=explode_tree_6.Branch2)
line_18 = Line(StartPoint=explode_tree_8.Branch1, EndPoint=explode_tree_6.Branch2)
line_19 = Line(StartPoint=explode_tree.Branch0, EndPoint=explode_tree_8.Branch5)
line_20 = Line(StartPoint=explode_tree_8.Branch3, EndPoint=explode_tree.Branch1)
arc_3pt_16 = Arc3Pt(PointA=explode_tree.Branch1, PointB=explode_tree_4.Branch3, PointC=explode_tree_5.Branch3)  # -> Arc, Plane, Radius
line_21 = Line(StartPoint=explode_tree_8.Branch4, EndPoint=explode_tree_5.Branch2)
arc_3pt_17 = Arc3Pt(PointA=explode_tree.Branch0, PointB=explode_tree_4.Branch2, PointC=explode_tree_5.Branch2)  # -> Arc, Plane, Radius
line_22 = Line(StartPoint=explode_tree_5.Branch2, EndPoint=explode_tree_6.Branch2)
line_23 = Line(StartPoint=explode_tree_8.Branch6, EndPoint=explode_tree_6.Branch0)
arc_3pt_18 = Arc3Pt(PointA=explode_tree.Branch0, PointB=explode_tree_2.Branch0, PointC=explode_tree_6.Branch0)  # -> Arc, Plane, Radius
arc_3pt_19 = Arc3Pt(PointA=explode_tree_6.Branch0, PointB=point, PointC=explode_tree.Branch1)  # -> Arc, Plane, Radius
arc_3pt_20 = Arc3Pt(PointA=explode_tree_8.Branch6, PointB=explode_tree_9.Branch6, PointC=explode_tree_8.Branch3)  # -> Arc, Plane, Radius
line_24 = Line(StartPoint=explode_tree_8.Branch6, EndPoint=list_item_5)
arc_3pt_21 = Arc3Pt(PointA=explode_tree_8.Branch5, PointB=explode_tree_9.Branch5, PointC=explode_tree_8.Branch6)  # -> Arc, Plane, Radius
line_25 = Line(StartPoint=explode_tree_8.Branch4, EndPoint=list_item_12)
line_26 = Line(StartPoint=explode_tree_7.Branch1, EndPoint=explode_tree_8.Branch4)
line_27 = Line(StartPoint=explode_tree_8.Branch4, EndPoint=explode_tree_8.Branch5)
line_28 = Line(StartPoint=explode_tree_8.Branch5, EndPoint=list_item_9)
line_29 = Line(StartPoint=list_item_10, EndPoint=explode_tree_8.Branch3)
line_30 = Line(StartPoint=explode_tree_8.Branch0, EndPoint=explode_tree_8.Branch3)
line_31 = Line(StartPoint=list_item_13, EndPoint=explode_tree_8.Branch0)
line_32 = Line(StartPoint=explode_tree_8.Branch1, EndPoint=explode_tree_8.Branch0)
line_33 = Line(StartPoint=explode_tree_8.Branch1, EndPoint=move_2.Geometry)
line_34 = Line(StartPoint=explode_tree_8.Branch1, EndPoint=explode_tree_8.Branch2)
line_35 = Line(StartPoint=move_3.Geometry, EndPoint=explode_tree_7.Branch1)
_4point_surface = _4PointSurface(CornerA=move_2.Geometry, CornerB=list_item_16, CornerC=move_3.Geometry, CornerD=construct_point_8)
_4point_surface_2 = _4PointSurface(CornerA=explode_tree_8.Branch2, CornerB=explode_tree_8.Branch1, CornerC=explode_tree_6.Branch2)
edge_surface = EdgeSurface(CurveA=arc_3pt_8.Arc, CurveB=arc_3pt_4.Arc, CurveC=arc_3pt_6.Arc, CurveD=line_2)
edge_surface_2 = EdgeSurface(CurveA=arc_3pt_9.Arc, CurveB=arc_3pt_4.Arc, CurveC=arc_3pt_7.Arc, CurveD=line_2)
edge_surface_3 = EdgeSurface(CurveA=arc_3pt_9.Arc, CurveB=arc_3pt.Arc, CurveC=line, CurveD=arc_3pt_3.Arc)
edge_surface_4 = EdgeSurface(CurveA=arc_3pt_8.Arc, CurveB=arc_3pt.Arc, CurveC=line, CurveD=arc_3pt_2.Arc)
edge_surface_5 = EdgeSurface(CurveA=line_10, CurveB=line_7, CurveC=line_8, CurveD=arc_3pt_14.Arc)
edge_surface_6 = EdgeSurface(CurveA=line_14, CurveB=line_11, CurveC=line_6, CurveD=arc_3pt_15.Arc)
edge_surface_7 = EdgeSurface(CurveA=arc_3pt_10.Arc, CurveB=line_10, CurveC=line_12, CurveD=line_4)
edge_surface_8 = EdgeSurface(CurveA=arc_3pt_13.Arc, CurveB=line_13, CurveC=line_14, CurveD=line_3)
edge_surface_9 = EdgeSurface(CurveA=line_5, CurveB=arc_3pt_11.Arc, CurveC=line_3, CurveD=arc_3pt_3.Arc)
edge_surface_10 = EdgeSurface(CurveA=line_5, CurveB=arc_3pt_12.Arc, CurveC=line_4, CurveD=arc_3pt_2.Arc)
edge_surface_11 = EdgeSurface(CurveA=line_29, CurveB=line_30, CurveC=line_31, CurveD=line_12)
edge_surface_12 = EdgeSurface(CurveA=line_31, CurveB=line_7, CurveC=line_32, CurveD=line_33)
edge_surface_13 = EdgeSurface(CurveA=arc_3pt_7.Arc, CurveB=arc_3pt_6.Arc, CurveC=arc_3pt_2.Arc, CurveD=arc_3pt_3.Arc)
edge_surface_14 = EdgeSurface(CurveA=line_33, CurveB=line_34, CurveC=line_35, CurveD=line_9)
edge_surface_15 = EdgeSurface(CurveA=line_35, CurveB=line_26, CurveC=line_25, CurveD=line_11)
edge_surface_16 = EdgeSurface(CurveA=line_25, CurveB=line_27, CurveC=line_28, CurveD=line_13)
edge_surface_17 = EdgeSurface(CurveA=line_28, CurveB=arc_3pt_21.Arc, CurveC=line_24, CurveD=arc_3pt_11.Arc)
edge_surface_18 = EdgeSurface(CurveA=line_24, CurveB=arc_3pt_20.Arc, CurveC=line_29, CurveD=arc_3pt_12.Arc)
edge_surface_19 = EdgeSurface(CurveA=line_20, CurveB=arc_3pt_16.Arc, CurveC=line_15, CurveD=line_30)
edge_surface_20 = EdgeSurface(CurveA=line_15, CurveB=line_32, CurveC=line_18, CurveD=line_16)
edge_surface_21 = EdgeSurface(CurveA=line_19, CurveB=line_27, CurveC=line_21, CurveD=arc_3pt_17.Arc)
edge_surface_22 = EdgeSurface(CurveA=line_21, CurveB=line_22, CurveC=line_17, CurveD=line_26)
edge_surface_23 = EdgeSurface(CurveA=line_23, CurveB=arc_3pt_18.Arc, CurveC=line_19, CurveD=arc_3pt_21.Arc)
edge_surface_24 = EdgeSurface(CurveA=line_23, CurveB=arc_3pt_20.Arc, CurveC=arc_3pt_19.Arc, CurveD=line_20)
brep = Brep([edge_surface, edge_surface_2, edge_surface_3, edge_surface_4, edge_surface_5, _4point_surface, edge_surface_6, edge_surface_7, edge_surface_8, edge_surface_9, edge_surface_10, edge_surface_11, edge_surface_12, edge_surface_13, edge_surface_14, edge_surface_15, edge_surface_16, edge_surface_17, edge_surface_18, edge_surface_19, edge_surface_20, _4point_surface_2, edge_surface_21, edge_surface_22, edge_surface_23, edge_surface_24])
object_bake = ObjectBake(
    BakeToggle=Toggle(True),
    GeometryObjects=brep,
    Layer="GH_Bake",
    ObjectName="GH_Obj",
    ObjectColor=RGB(255, 255, 255),
    LayerColor=RGB(255, 255, 255))
