# Grasshopper definition cube.gh (Grasshopper 1.0.7)
# plug-ins: Bifocals

number_slider = Slider(0, range=0..100)
number_slider_2 = Slider(19, range=0..100)
construct_point = ConstructPoint(XCoordinate=number_slider, YCoordinate=number_slider, ZCoordinate=number_slider)
construct_point_2 = ConstructPoint(XCoordinate=number_slider_2, YCoordinate=number_slider, ZCoordinate=number_slider)
construct_point_3 = ConstructPoint(XCoordinate=number_slider_2, YCoordinate=number_slider_2, ZCoordinate=number_slider)
construct_point_4 = ConstructPoint(XCoordinate=number_slider, YCoordinate=number_slider_2, ZCoordinate=number_slider)
construct_point_5 = ConstructPoint(XCoordinate=number_slider, YCoordinate=number_slider, ZCoordinate=number_slider_2)
construct_point_6 = ConstructPoint(XCoordinate=number_slider_2, YCoordinate=number_slider, ZCoordinate=number_slider_2)
construct_point_7 = ConstructPoint(XCoordinate=number_slider_2, YCoordinate=number_slider_2, ZCoordinate=number_slider_2)
construct_point_8 = ConstructPoint(XCoordinate=number_slider, YCoordinate=number_slider_2, ZCoordinate=number_slider_2)
line = Line(StartPoint=construct_point, EndPoint=construct_point_2)
line_2 = Line(StartPoint=construct_point, EndPoint=construct_point_4)
line_3 = Line(StartPoint=construct_point_4, EndPoint=construct_point_3)
line_4 = Line(StartPoint=construct_point_3, EndPoint=construct_point_2)
line_5 = Line(StartPoint=construct_point, EndPoint=construct_point_5)
line_6 = Line(StartPoint=construct_point_2, EndPoint=construct_point_6)
line_7 = Line(StartPoint=construct_point_3, EndPoint=construct_point_7)
line_8 = Line(StartPoint=construct_point_4, EndPoint=construct_point_8)
line_9 = Line(StartPoint=construct_point_5, EndPoint=construct_point_6)
line_10 = Line(StartPoint=construct_point_7, EndPoint=construct_point_6)
line_11 = Line(StartPoint=construct_point_8, EndPoint=construct_point_7)
line_12 = Line(StartPoint=construct_point_5, EndPoint=construct_point_8)
end_points = EndPoints(Curve=line_10)  # -> Start, End
end_points_2 = EndPoints(Curve=[line_4, line_3, line_2, line, line_5, line_6, line_7, line_8, line_9, line_10, line_11, line_12])  # -> Start, End
pipe = Pipe(
    Curve=[line, line_2, line_3, line_4, line_5, line_6, line_7, line_8, line_9, line_12, line_11, line_10],
    Radius=Slider(0.5, range=0..1),
    Caps=Slider(2, range=0..10))
scale = Scale(Geometry=pipe, Center=Point(0, 0, 0), Factor=Slider(2, range=0..100))  # -> Geometry, Transform
explode_tree = ExplodeTree(Data=pipe)  # -> Branch0, Branch1, Branch2, Branch3, Branch4, Branch5, Branch6, Branch7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
list_item = ListItem(List=[end_points.Start, end_points.End], Index=Slider(1, range=0..11), Wrap=True)
unit_z = UnitZ(Factor=Slider(9.5, range=0..10))
scale_2 = Scale(Geometry=[end_points_2.Start, list_item], Center=Point(0, 0, 0), Factor=Slider(2, range=0..10))  # -> Geometry, Transform
move = Move(Geometry=[end_points_2.Start, list_item], Motion=unit_z)  # -> Geometry, Transform
unit_y = UnitY(Factor=Slider(9.5, range=0..10))
move_2 = Move(Geometry=move.Geometry, Motion=unit_y)  # -> Geometry, Transform
unit_x = UnitX(Factor=Slider(9.5, range=0..10))
move_3 = Move(Geometry=move_2.Geometry, Motion=unit_x)  # -> Geometry, Transform
line_13 = Line(StartPoint=scale_2.Geometry, EndPoint=move_3.Geometry)
pipe_2 = Pipe(Curve=line_13, Radius=Slider(0.5, range=0..1), Caps=Slider(2, range=0..10))
unit_z_2 = UnitZ(Factor=Slider(9.5, range=0..10))
unit_y_2 = UnitY(Factor=Slider(9.5, range=0..10))
unit_x_2 = UnitX(Factor=Slider(9.5, range=0..10))

# ----
# chang me to chang dimision
value_list = ValueList({"One": 1, "Two": 2, "Three": 2² - 1, "Four": Sqrt(16)}, selected="Four")

geometry = Geometry(explode_tree.Branch0)
geometry_2 = Geometry([explode_tree.Branch0, explode_tree.Branch1, explode_tree.Branch2, explode_tree.Branch3])
geometry_3 = Geometry([explode_tree.Branch11, explode_tree.Branch10, explode_tree.Branch9, explode_tree.Branch8, explode_tree.Branch7, explode_tree.Branch6, explode_tree.Branch5, explode_tree.Branch4, explode_tree.Branch3, explode_tree.Branch2, explode_tree.Branch1, explode_tree.Branch0])
move_4 = Move(Geometry=geometry_3, Motion=unit_z_2)  # -> Geometry, Transform
move_5 = Move(Geometry=move_4.Geometry, Motion=unit_y_2)  # -> Geometry, Transform
move_6 = Move(Geometry=move_5.Geometry, Motion=unit_x_2)  # -> Geometry, Transform
geometry_4 = Geometry([scale.Geometry, move_6.Geometry, pipe_2])
stream_filter = StreamFilter(Gate=value_list, Stream1=geometry, Stream2=geometry_2, Stream3=geometry_3, Stream4=geometry_4)
custom_preview = CustomPreview(
    Geometry=stream_filter,
    Material={diffuse=RGB(221, 160, 221), emission=RGB(66, 48, 66), shine=0.5, specular=RGB(255, 255, 255), transparency=0})
